# Grasshopper definition Mesh segmentation coding parts of it.gh (Grasshopper 1.0.7)
# plug-ins: MeshEdit Components, Thesistheamazingtwo

# ---- group: VOXELS
geometry = Geometry([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])

# ---- group: GEOMETRIES
geometry_2 = Geometry([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])

# ----
area = Area(Geometry=geometry)  # -> Area, Centroid
encoder = Encoder(InputVoxels=geometry, InputChuncks=geometry_2)  # -> BinaryCodes, UniqueBinaryCodes, EncodedList
text_tag = TextTag(Location=area.Centroid, Text=encoder.EncodedList, Colour=ColourSwatch(SwatchColor=RGB(255, 255, 255)))
panel = Panel(encoder.EncodedList)
panel_2 = Panel(encoder.UniqueBinaryCodes)
panel_3 = Panel(encoder.BinaryCodes)

vector_xyz = VectorXYZ(XComponent=Slider(16, range=0..100), YComponent=Slider(12, range=0..100), ZComponent=Slider(2, range=0..100))  # -> Vector, Length
vector_xyz_2 = VectorXYZ(XComponent=Slider(6, range=0..10), YComponent=Slider(6, range=0..10), ZComponent=Slider(1, range=0..10))  # -> Vector, Length
model_synthesis = ModelSynthesis(
    InputModel=geometry,
    InputValues=encoder.EncodedList,
    PatternSize=Slider(2, range=1..10),
    InputSize=vector_xyz.Vector,
    OutputSize=vector_xyz_2.Vector,
    Probabilistic=Toggle(True),
    Periodic=Toggle(True),
    Generate=Button())  # -> OutputModel, OutputValues, Patterns, Probabilities
panel_4 = Panel(model_synthesis.OutputValues)
panel_5 = Panel(model_synthesis.Patterns)
panel_6 = Panel(model_synthesis.Probabilities)

# ----
# info: Sometimes not all the tiles exist in the output model.This component gives the values that correspond to the unique elements that exist in the output model.It also gives the equivalent voxel ad the equavalent mesh.The 3 list given must have the same number of elements.
collection = Collection(
    OutputValues=model_synthesis.OutputValues,
    EncodedList=encoder.EncodedList,
    InputVoxels=geometry,
    InputChuncks=geometry_2)  # -> OutputUnique, MeshesFound, VoxelsFound
# info: This component gives all the tiles we will need to fill the output model.If number 3 exist in our output 5 times we will get the equivalent mesh and voxel also 5 times and in the corrent index.
decoder = Decoder(
    OutputModel=model_synthesis.OutputModel,
    OutputValues=model_synthesis.OutputValues,
    OutputUnique=collection.OutputUnique,
    MeshesCollection=collection.MeshesFound,
    VoxelsCollection=collection.VoxelsFound)  # -> OutputGeometries, VoxelsCenters
area_2 = Area(Geometry=model_synthesis.OutputModel)  # -> Area, Centroid

# ---- group: Moving tiles and dislaying numbers
# info: Our geometry is all the tiles that exist in the output model.Our source is the center of their boundary voxels in the input model, our target is the center of their boundary voxels in the output model.
orient = Orient(Geometry=decoder.OutputGeometries, Source=decoder.VoxelsCenters, Target=area_2.Centroid)  # -> Geometry, Transform
r = Slider(18, range=0..100)
unit_x = UnitX(Factor=r)
move = Move(Geometry=orient.Geometry, Motion=unit_x)  # -> Geometry, Transform
mesh_area = MeshArea(Mesh=move.Geometry)  # -> Area, Centroid
custom_preview = CustomPreview(Geometry=move.Geometry, Material=ColourSwatch(SwatchColor=RGB(204, 75, 188)))
text_tag_2 = TextTag(Location=mesh_area.Centroid, Text=model_synthesis.OutputValues, Colour=ColourSwatch(SwatchColor=RGB(255, 255, 255)))
