# Grasshopper definition Mesh segmentation pluw weaverbird.gh (Grasshopper 1.0.7)
# plug-ins: MeshEdit Components, Thesistheamazingtwo, Weaverbird

number_slider = Slider(0.5, range=0..1)
construct_point = ConstructPoint(XCoordinate=number_slider, YCoordinate=number_slider, ZCoordinate=number_slider)
number_slider_2 = Slider(0.5, range=0..1)
number_slider_3 = Slider(0.5, range=0..1)

# ---- group: Input surface
brep = Brep(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)
mesh_brep = MeshBrep(
    Brep=brep,
    Settings={GridMaxCount=0, GridMinCount=16, JaggedSeams=False, MaxEdgeLength=0, MinEdgeLength=0.0001, MinTolerance=0, Refine=True, RefineAngle=0, RelativeTolerance=0.65, SimplePlanes=True, Tolerance=0})

# ----
construct_plane = ConstructPlane(Origin=construct_point, XAxis=Vector(1, 0, 0), YAxis=Vector(0, 1, 0))
number_slider_4 = Slider(0.5, range=0..1)
construct_point_2 = ConstructPoint(XCoordinate=number_slider_2, YCoordinate=number_slider_2, ZCoordinate=number_slider_2)
geometry = Geometry([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])
geometry_2 = Geometry([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])
number_slider_5 = Slider(0.5, range=0..1)
center_box = CenterBox(Base=construct_plane, X=number_slider_3, Y=number_slider_3, Z=number_slider_3)

# ---- group: Input surface
brep_2 = Brep(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)
mesh_brep_2 = MeshBrep(
    Brep=brep_2,
    Settings={GridMaxCount=0, GridMinCount=16, JaggedSeams=False, MaxEdgeLength=0, MinEdgeLength=0.0001, MinTolerance=0, Refine=True, RefineAngle=0, RelativeTolerance=0.65, SimplePlanes=True, Tolerance=0})

# ----
construct_plane_2 = ConstructPlane(Origin=construct_point_2, XAxis=Vector(1, 0, 0), YAxis=Vector(0, 1, 0))
encoder = Encoder(InputVoxels=geometry_2, InputChuncks=geometry)
construct_point_3 = ConstructPoint(XCoordinate=number_slider_4, YCoordinate=number_slider_4, ZCoordinate=number_slider_4)
number_slider_6 = Slider(0.5, range=0..1)
weaverbird_s_mesh_thicken = WeaverbirdsMeshThicken(MeshCurves=mesh_brep, Distance=Slider(0.1, range=0..1), OffsetType=0)
center_box_2 = CenterBox(Base=construct_plane_2, X=number_slider_5, Y=number_slider_5, Z=number_slider_5)

# ---- group: Input surface
brep_3 = Brep(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)
mesh_brep_3 = MeshBrep(
    Brep=brep_3,
    Settings={GridMaxCount=0, GridMinCount=16, JaggedSeams=False, MaxEdgeLength=0, MinEdgeLength=0.0001, MinTolerance=0, Refine=True, RefineAngle=0, RelativeTolerance=0.65, SimplePlanes=True, Tolerance=0})

# ----
construct_plane_3 = ConstructPlane(Origin=construct_point_3, XAxis=Vector(1, 0, 0), YAxis=Vector(0, 1, 0))
box_array = BoxArray(
    Geometry=center_box,
    Cell=center_box,
    XCount=Slider(8, range=0..100),
    YCount=Slider(1, range=0..100),
    ZCount=Slider(8, range=0..100))  # -> Geometry, Transform
panel = Panel(encoder)
center_box_3 = CenterBox(Base=construct_plane_3, X=number_slider_6, Y=number_slider_6, Z=number_slider_6)
weaverbird_s_mesh_thicken_2 = WeaverbirdsMeshThicken(MeshCurves=mesh_brep_2, Distance=Slider(0.01, range=0..1), OffsetType=0)
simple_mesh = SimpleMesh(Brep=box_array.Geometry)
box_array_2 = BoxArray(
    Geometry=center_box_2,
    Cell=center_box_2,
    XCount=Slider(8, range=0..100),
    YCount=Slider(1, range=0..100),
    ZCount=Slider(8, range=0..100))  # -> Geometry, Transform
mesh_weldvertices = MeshWeldVertices(Mesh=simple_mesh, Tolerance=0.01)  # -> RuntimeMessage, Mesh
weaverbird_s_mesh_thicken_3 = WeaverbirdsMeshThicken(MeshCurves=mesh_brep_3, Distance=Slider(0.01, range=0..1), OffsetType=0)
simple_mesh_2 = SimpleMesh(Brep=box_array_2.Geometry)
graft_tree = GraftTree(Tree=mesh_weldvertices.Mesh, IncludeEmptyLists=True, IncludeNullItems=True)
box_array_3 = BoxArray(
    Geometry=center_box_3,
    Cell=center_box_3,
    XCount=Slider(8, range=0..100),
    YCount=Slider(1, range=0..100),
    ZCount=Slider(8, range=0..100))  # -> Geometry, Transform

# ---- group: UNIQUE INDEX LIST
encoder_2 = CSharpScript(Codes=flatten(panel), Chuncks=geometry)  # -> out, Unique, Encoded, Decoded; inputs Codes: list of String, Chuncks: list of Mesh
# ---------- encoder_2: C# usings ----------
using System.Drawing;
# ---------- encoder_2: C# ----------
    //get the unique items from the code list
    var unique_items = new HashSet<string>(Codes);


    //create an array with the unique strings
    string [] unique_array = new string[unique_items.Count + 1];
    unique_items.CopyTo(unique_array, 1);
    Unique = unique_array;



    //encode the list of colors based on the indices in the unique array

    var encoded_list = new List<int>();
    for (int i = 0; i < Codes.Count; i++)
    {
      for (int j = 0; j < unique_array.Length; j++)
      {
        if(unique_array[j] == Codes[i])
        {
          encoded_list.Add(j);


        }

      }
    }
    Encoded = encoded_list;


    //decode the list to retrieve the color values
    var decoded_list = new List<string>();

    for (int i = 0; i < encoded_list.Count; i++)
    {
      for (int j = 0; j < unique_array.Length; j++)
      {
        if(encoded_list[i] == j)
        {
          decoded_list.Add(unique_array[j]);
        }

      }

    }
    Decoded = decoded_list;
# ---------- end encoder_2 ----------
encoded = Panel(encoder_2.Encoded)
unique = Panel(encoder_2.Unique)

# ---- group: numbers on the input model
area = Area(Geometry=geometry_2)  # -> Area, Centroid
text_tag = TextTag(Location=area.Centroid, Text=encoded, Colour=ColourSwatch(SwatchColor=RGB(255, 255, 255)))

# ----
mesh_intersection = MeshIntersection(MeshesA=weaverbird_s_mesh_thicken, MeshesB=graft_tree)  # -> simplify(Result)
mesh_weldvertices_2 = MeshWeldVertices(Mesh=simple_mesh_2, Tolerance=0.01)  # -> RuntimeMessage, Mesh
simple_mesh_3 = SimpleMesh(Brep=box_array_3.Geometry)
graft_tree_2 = GraftTree(Tree=mesh_weldvertices_2.Mesh, IncludeEmptyLists=True, IncludeNullItems=True)
number_slider_7 = Slider(99, range=0..100)
mesh_weldvertices_3 = MeshWeldVertices(Mesh=simple_mesh_3, Tolerance=0.01)  # -> RuntimeMessage, Mesh
mesh_intersection_2 = MeshIntersection(MeshesA=weaverbird_s_mesh_thicken_2, MeshesB=graft_tree_2)  # -> simplify(Result)
tree_statistics = TreeStatistics(Tree=mesh_intersection)  # -> Paths, Length, Count
graft_tree_3 = GraftTree(Tree=mesh_weldvertices_3.Mesh, IncludeEmptyLists=True, IncludeNullItems=True)
tree_item = TreeItem(Tree=mesh_intersection, Path=tree_statistics.Paths, Index=0, Wrap=True)
member_index = MemberIndex(Set=panel, Member=graft(encoder_2.Unique))  # -> Index, Count
list_item = ListItem(List=tree_statistics.Paths, Index=number_slider_7, Wrap=True)
mesh_intersection_3 = MeshIntersection(MeshesA=weaverbird_s_mesh_thicken_3, MeshesB=graft_tree_3)  # -> simplify(Result)
number_slider_8 = Slider(99, range=0..100)
tree_statistics_2 = TreeStatistics(Tree=mesh_intersection_2)  # -> Paths, Length, Count

# ---- group: box
list_item_2 = ListItem(List=mesh_weldvertices.Mesh, Index=number_slider_7, Wrap=True)

# ---- group: mesh chunck
tree_branch = TreeBranch(Tree=mesh_intersection, Path=list_item, MaintainPaths=True)
custom_preview = CustomPreview(Geometry=tree_branch, Material=ColourSwatch(SwatchColor=RGB(255, 46, 189)))

# ----
encoder_3 = Encoder(InputVoxels=flatten(box_array.Geometry), InputChuncks=tree_item)
panel_2 = Panel(tree_item)
list_item_3 = ListItem(List=member_index.Index, Index=0, Wrap=True)
tree_item_2 = TreeItem(Tree=mesh_intersection_2, Path=tree_statistics_2.Paths, Index=0, Wrap=True)
list_item_4 = ListItem(List=tree_statistics_2.Paths, Index=number_slider_8, Wrap=True)
number_slider_9 = Slider(99, range=0..100)
tree_statistics_3 = TreeStatistics(Tree=mesh_intersection_3)  # -> Paths, Length, Count
vector_xyz = VectorXYZ(XComponent=Slider(8, range=0..100), YComponent=Slider(8, range=0..100), ZComponent=Slider(3, range=0..100))  # -> Vector, Length
vector_xyz_2 = VectorXYZ(XComponent=Slider(8, range=0..10), YComponent=Slider(9, range=0..10), ZComponent=Slider(1, range=0..10))  # -> Vector, Length

# ---- group: box
list_item_5 = ListItem(List=mesh_weldvertices_2.Mesh, Index=number_slider_8, Wrap=True)

# ---- group: mesh chunck
tree_branch_2 = TreeBranch(Tree=mesh_intersection_2, Path=list_item_4, MaintainPaths=True)
custom_preview_2 = CustomPreview(Geometry=tree_branch_2, Material=ColourSwatch(SwatchColor=RGB(255, 46, 189)))

# ----
encoder_4 = Encoder(InputVoxels=flatten(box_array_2.Geometry), InputChuncks=tree_item_2)
panel_3 = Panel(tree_item_2)
list_item_6 = ListItem(List=geometry_2, Index=list_item_3, Wrap=True)  # -> flatten(Item)
list_item_7 = ListItem(List=geometry, Index=list_item_3, Wrap=True)  # -> flatten(Item)
tree_item_3 = TreeItem(Tree=mesh_intersection_3, Path=tree_statistics_3.Paths, Index=0, Wrap=True)
panel_4 = Panel(encoder_3)
list_item_8 = ListItem(List=tree_statistics_3.Paths, Index=number_slider_9, Wrap=True)

# ---- group: box
list_item_9 = ListItem(List=mesh_weldvertices_3.Mesh, Index=number_slider_9, Wrap=True)

# ---- group: mesh chunck
tree_branch_3 = TreeBranch(Tree=mesh_intersection_3, Path=list_item_8, MaintainPaths=True)
custom_preview_3 = CustomPreview(Geometry=tree_branch_3, Material=ColourSwatch(SwatchColor=RGB(255, 46, 189)))

# ----
encoder_5 = Encoder(InputVoxels=flatten(box_array_3.Geometry), InputChuncks=tree_item_3)
panel_5 = Panel(tree_item_3)
evaluate_box = EvaluateBox(Box=list_item_6, UParameter=0.5, VParameter=0.5, WParameter=0.5)  # -> Plane, Point, Include
panel_6 = Panel(list_item_7)
model_synthesis = ModelSynthesis(
    InputModel=geometry_2,
    InputValues=encoder_2.Encoded,
    PatternSize=Slider(2, range=1..10),
    InputSize=vector_xyz.Vector,
    OutputSize=vector_xyz_2.Vector,
    Probabilistic=Toggle(True),
    Periodic=Toggle(True),
    Generate=Button())  # -> OutputModel, OutputValues, Patterns, Probabilities
panel_7 = Panel(encoder_4)
graft_tree_4 = GraftTree(Tree=evaluate_box.Point, IncludeEmptyLists=True, IncludeNullItems=True)  # -> simplify(Tree)
graft_tree_5 = GraftTree(Tree=list_item_7, IncludeEmptyLists=True, IncludeNullItems=True)  # -> simplify(Tree)

# ---- group: UNIQUE INDEX LIST
encoder_6 = CSharpScript(Codes=flatten(panel_4), Chuncks=tree_item)  # -> out, Unique, Encoded, Decoded; inputs Codes: list of String, Chuncks: list of Mesh; same code as encoder_2
encoded_2 = Panel(encoder_6.Encoded)
unique_2 = Panel(encoder_6.Unique)

# ----
panel_8 = Panel(model_synthesis.OutputValues)
panel_9 = Panel(model_synthesis.Patterns)
panel_10 = Panel(model_synthesis.Probabilities)
panel_11 = Panel(encoder_5)
geometry_3 = Geometry()
area_2 = Area(Geometry=model_synthesis.OutputModel)  # -> Area, simplify(graft(Centroid))

# ---- group: UNIQUE INDEX LIST
encoder_7 = CSharpScript(Codes=flatten(panel_7), Chuncks=tree_item_2)  # -> out, Unique, Encoded, Decoded; inputs Codes: list of String, Chuncks: list of Mesh; same code as encoder_2
encoded_3 = Panel(encoder_7.Encoded)
unique_3 = Panel(encoder_7.Unique)

# ----
geometry_4 = Geometry()
tree_statistics_4 = TreeStatistics(Tree=area_2.Centroid)  # -> Paths, Length, Count
graft_tree_6 = GraftTree(Tree=model_synthesis.OutputValues, IncludeEmptyLists=True, IncludeNullItems=True)

area_3 = Area(Geometry=model_synthesis.OutputModel)  # -> Area, Centroid
unit_x = UnitX(Factor=Slider(9, range=0..100))
move = Move(Geometry=area_3.Centroid, Motion=unit_x)  # -> Geometry, Transform
text_tag_2 = TextTag(Location=move.Geometry, Text=panel_8)

construct_path = ConstructPath(Indices=graft_tree_6)  # -> flatten(Branch)
member_index_2 = MemberIndex(Set=panel_4, Member=graft(encoder_6.Unique))  # -> Index, Count

# ---- group: UNIQUE INDEX LIST
encoder_8 = CSharpScript(Codes=flatten(panel_11), Chuncks=tree_item_3)  # -> out, Unique, Encoded, Decoded; inputs Codes: list of String, Chuncks: list of Mesh; same code as encoder_2
encoded_4 = Panel(encoder_8.Encoded)
unique_4 = Panel(encoder_8.Unique)

# ----
geometry_5 = Geometry()
replace_items = ReplaceItems(List="0", Indices="0", Wrap=False)  # -> simplify(flatten(List))
replace_paths = ReplacePaths(Data=area_2.Centroid, Search=tree_statistics_4.Paths, Replace=construct_path)
list_item_10 = ListItem(List=member_index_2.Index, Index=0, Wrap=True)
member_index_3 = MemberIndex(Set=panel_7, Member=graft(encoder_7.Unique))  # -> Index, Count
merge = Merge(Data1=simplify(replace_items), Data2=simplify(replace_paths))
vector_xyz_3 = VectorXYZ(XComponent=Slider(8, range=0..100), YComponent=Slider(2, range=0..100), ZComponent=Slider(8, range=0..100))  # -> Vector, Length
vector_xyz_4 = VectorXYZ(XComponent=Slider(8, range=0..10), YComponent=Slider(1, range=0..10), ZComponent=Slider(8, range=0..10))  # -> Vector, Length
list_item_11 = ListItem(List=box_array.Geometry, Index=list_item_10, Wrap=True)  # -> flatten(Item)
list_item_12 = ListItem(List=tree_item, Index=list_item_10, Wrap=True)  # -> flatten(Item)
list_item_13 = ListItem(List=member_index_3.Index, Index=0, Wrap=True)
member_index_4 = MemberIndex(Set=panel_11, Member=graft(encoder_8.Unique))  # -> Index, Count
evaluate_box_2 = EvaluateBox(Box=list_item_11, UParameter=0.5, VParameter=0.5, WParameter=0.5)  # -> Plane, Point, Include
tree_statistics_5 = TreeStatistics(Tree=merge)  # -> Paths, Length, Count
tree_branch_4 = TreeBranch(Tree=graft_tree_5, Path=tree_statistics_5.Paths, MaintainPaths=True)
tree_branch_5 = TreeBranch(Tree=graft_tree_4, Path=tree_statistics_5.Paths, MaintainPaths=True)
orient = Orient(Geometry=simplify(tree_branch_4), Source=simplify(tree_branch_5), Target=merge)  # -> Geometry, Transform
vector_xyz_5 = VectorXYZ(XComponent=Slider(8, range=0..100), YComponent=Slider(2, range=0..100), ZComponent=Slider(8, range=0..100))  # -> Vector, Length
vector_xyz_6 = VectorXYZ(XComponent=Slider(4, range=0..10), YComponent=Slider(1, range=0..10), ZComponent=Slider(4, range=0..10))  # -> Vector, Length
list_item_14 = ListItem(List=box_array_2.Geometry, Index=list_item_13, Wrap=True)  # -> flatten(Item)
panel_12 = Panel(list_item_12)
model_synthesis_2 = ModelSynthesis(
    InputModel=box_array.Geometry,
    InputValues=encoder_6.Encoded,
    PatternSize=Slider(2, range=1..10),
    InputSize=vector_xyz_3.Vector,
    OutputSize=vector_xyz_4.Vector,
    Probabilistic=Toggle(True),
    Periodic=Toggle(True),
    Generate=Button())  # -> OutputModel, OutputValues, Patterns, Probabilities
list_item_15 = ListItem(List=tree_item_2, Index=list_item_13, Wrap=True)  # -> flatten(Item)

# ---- group: ouput model
r = Slider(9, range=0..100)
unit_x_2 = UnitX(Factor=r)
move_2 = Move(Geometry=orient.Geometry, Motion=unit_x_2)  # -> Geometry, Transform
custom_preview_4 = CustomPreview(Geometry=move_2.Geometry, Material=ColourSwatch(SwatchColor=RGB(208, 83, 187)))

# ----
list_item_16 = ListItem(List=member_index_4.Index, Index=0, Wrap=True)
evaluate_box_3 = EvaluateBox(Box=list_item_14, UParameter=0.5, VParameter=0.5, WParameter=0.5)  # -> Plane, Point, Include
list_item_17 = ListItem(List=box_array_3.Geometry, Index=list_item_16, Wrap=True)  # -> flatten(Item)
vector_xyz_7 = VectorXYZ(XComponent=Slider(8, range=0..100), YComponent=Slider(2, range=0..100), ZComponent=Slider(8, range=0..100))  # -> Vector, Length
vector_xyz_8 = VectorXYZ(XComponent=Slider(8, range=0..10), YComponent=Slider(1, range=0..10), ZComponent=Slider(8, range=0..10))  # -> Vector, Length
panel_13 = Panel(list_item_15)
list_item_18 = ListItem(List=tree_item_3, Index=list_item_16, Wrap=True)  # -> flatten(Item)
model_synthesis_3 = ModelSynthesis(
    InputModel=box_array_2.Geometry,
    InputValues=encoder_7.Encoded,
    PatternSize=Slider(2, range=1..10),
    InputSize=vector_xyz_5.Vector,
    OutputSize=vector_xyz_6.Vector,
    Probabilistic=Toggle(True),
    Periodic=Toggle(True),
    Generate=Button())  # -> OutputModel, OutputValues, Patterns, Probabilities
panel_14 = Panel(tree_statistics_5.Paths)
evaluate_box_4 = EvaluateBox(Box=list_item_17, UParameter=0.5, VParameter=0.5, WParameter=0.5)  # -> Plane, Point, Include
panel_15 = Panel(model_synthesis_2.OutputModel)
panel_16 = Panel(model_synthesis_2.OutputValues)
panel_17 = Panel(model_synthesis_2.Patterns)
panel_18 = Panel(model_synthesis_2.Probabilities)
area_4 = Area(Geometry=model_synthesis_2.OutputModel)  # -> Area, simplify(graft(Centroid))
graft_tree_7 = GraftTree(Tree=list_item_12, IncludeEmptyLists=True, IncludeNullItems=True)
graft_tree_8 = GraftTree(Tree=evaluate_box_2.Point, IncludeEmptyLists=True, IncludeNullItems=True)
panel_19 = Panel(list_item_18)
model_synthesis_4 = ModelSynthesis(
    InputModel=box_array_3.Geometry,
    InputValues=encoder_8.Encoded,
    PatternSize=Slider(2, range=1..10),
    InputSize=vector_xyz_7.Vector,
    OutputSize=vector_xyz_8.Vector,
    Probabilistic=Toggle(True),
    Periodic=Toggle(True),
    Generate=Button())  # -> OutputModel, OutputValues, Patterns, Probabilities
tree_statistics_6 = TreeStatistics(Tree=area_4.Centroid)  # -> Paths, Length, Count
graft_tree_9 = GraftTree(Tree=model_synthesis_2.OutputValues, IncludeEmptyLists=True, IncludeNullItems=True)
panel_20 = Panel(model_synthesis_3.OutputModel)
panel_21 = Panel(model_synthesis_3.OutputValues)
panel_22 = Panel(model_synthesis_3.Patterns)
panel_23 = Panel(model_synthesis_3.Probabilities)
area_5 = Area(Geometry=model_synthesis_3.OutputModel)  # -> Area, simplify(graft(Centroid))
graft_tree_10 = GraftTree(Tree=list_item_15, IncludeEmptyLists=True, IncludeNullItems=True)
graft_tree_11 = GraftTree(Tree=evaluate_box_3.Point, IncludeEmptyLists=True, IncludeNullItems=True)
construct_path_2 = ConstructPath(Indices=graft_tree_9)  # -> flatten(Branch)
tree_statistics_7 = TreeStatistics(Tree=graft_tree_8)  # -> Paths, Length, Count
tree_statistics_8 = TreeStatistics(Tree=area_5.Centroid)  # -> Paths, Length, Count
graft_tree_12 = GraftTree(Tree=model_synthesis_3.OutputValues, IncludeEmptyLists=True, IncludeNullItems=True)
panel_24 = Panel(model_synthesis_4.OutputModel)
panel_25 = Panel(model_synthesis_4.OutputValues)
panel_26 = Panel(model_synthesis_4.Patterns)
panel_27 = Panel(model_synthesis_4.Probabilities)
area_6 = Area(Geometry=model_synthesis_4.OutputModel)  # -> Area, simplify(graft(Centroid))
replace_paths_2 = ReplacePaths(Data=area_4.Centroid, Search=tree_statistics_6.Paths, Replace=construct_path_2)
graft_tree_13 = GraftTree(Tree=list_item_18, IncludeEmptyLists=True, IncludeNullItems=True)
graft_tree_14 = GraftTree(Tree=evaluate_box_4.Point, IncludeEmptyLists=True, IncludeNullItems=True)
construct_path_3 = ConstructPath(Indices=graft_tree_12)  # -> flatten(Branch)
replace_items_2 = ReplaceItems(List="0", Indices="0", Wrap=False)  # -> simplify(flatten(List))
tree_statistics_9 = TreeStatistics(Tree=graft_tree_11)  # -> Paths, Length, Count
tree_statistics_10 = TreeStatistics(Tree=area_6.Centroid)  # -> Paths, Length, Count
graft_tree_15 = GraftTree(Tree=model_synthesis_4.OutputValues, IncludeEmptyLists=True, IncludeNullItems=True)
replace_paths_3 = ReplacePaths(Data=area_5.Centroid, Search=tree_statistics_8.Paths, Replace=construct_path_3)
construct_path_4 = ConstructPath(Indices=graft_tree_15)  # -> flatten(Branch)
merge_2 = Merge(Data1=simplify(replace_items_2), Data2=simplify(replace_paths_2))
tree_statistics_11 = TreeStatistics(Tree=graft_tree_14)  # -> Paths, Length, Count
replace_items_3 = ReplaceItems(List="0", Indices="0", Wrap=False)  # -> simplify(flatten(List))
replace_paths_4 = ReplacePaths(Data=area_6.Centroid, Search=tree_statistics_10.Paths, Replace=construct_path_4)
tree_statistics_12 = TreeStatistics(Tree=merge_2)  # -> Paths, Length, Count
shortest_list = ShortestList(ListListA=tree_statistics_12.Paths, ListListB=tree_statistics_7.Paths, TrimMode=2)  # -> ListListA, ListListB
tree_branch_6 = TreeBranch(Tree=graft_tree_7, Path=shortest_list.ListListB, MaintainPaths=True)
tree_branch_7 = TreeBranch(Tree=graft_tree_8, Path=shortest_list.ListListB, MaintainPaths=True)
orient_2 = Orient(Geometry=simplify(tree_branch_6), Source=simplify(tree_branch_7), Target=merge_2)  # -> Geometry, Transform
merge_3 = Merge(Data1=simplify(replace_items_3), Data2=simplify(replace_paths_3))
replace_items_4 = ReplaceItems(List="0", Indices="0", Wrap=False)  # -> simplify(flatten(List))
custom_preview_5 = CustomPreview(Geometry=orient_2.Geometry, Material=ColourSwatch(SwatchColor=RGB(99, 211, 255)))
tree_statistics_13 = TreeStatistics(Tree=merge_3)  # -> Paths, Length, Count
shortest_list_2 = ShortestList(ListListA=tree_statistics_13.Paths, ListListB=tree_statistics_9.Paths, TrimMode=2)  # -> ListListA, ListListB
tree_branch_8 = TreeBranch(Tree=graft_tree_10, Path=shortest_list_2.ListListB, MaintainPaths=True)
tree_branch_9 = TreeBranch(Tree=graft_tree_11, Path=shortest_list_2.ListListB, MaintainPaths=True)
orient_3 = Orient(Geometry=simplify(tree_branch_8), Source=simplify(tree_branch_9), Target=merge_3)  # -> Geometry, Transform
merge_4 = Merge(Data1=simplify(replace_items_4), Data2=simplify(replace_paths_4))
custom_preview_6 = CustomPreview(Geometry=orient_3.Geometry, Material=ColourSwatch(SwatchColor=RGB(94, 255, 255)))
tree_statistics_14 = TreeStatistics(Tree=merge_4)  # -> Paths, Length, Count
shortest_list_3 = ShortestList(ListListA=tree_statistics_14.Paths, ListListB=tree_statistics_11.Paths, TrimMode=2)  # -> ListListA, ListListB
tree_branch_10 = TreeBranch(Tree=graft_tree_13, Path=shortest_list_3.ListListB, MaintainPaths=True)
tree_branch_11 = TreeBranch(Tree=graft_tree_14, Path=shortest_list_3.ListListB, MaintainPaths=True)
orient_4 = Orient(Geometry=simplify(tree_branch_10), Source=simplify(tree_branch_11), Target=merge_4)  # -> Geometry, Transform
geometry_6 = Geometry(orient_4.Geometry)
custom_preview_7 = CustomPreview(Geometry=orient_4.Geometry, Material=ColourSwatch(SwatchColor=RGB(94, 255, 255)))
