# Grasshopper definition Voxel_0.gh (Grasshopper 1.0.7)

# ---- group: surf chunk
brep = Brep(<brep referenced from the Rhino model>)

# ---- group: box
brep_2 = Brep(<brep referenced from the Rhino model>)

# ----
deconstruct_brep = DeconstructBrep(Brep=brep)  # -> Faces, Edges, Vertices
deconstruct_brep_2 = DeconstructBrep(Brep=brep_2)  # -> graft(Faces), Edges, Vertices
divide_surface = DivideSurface(Surface=deconstruct_brep_2.Faces, UCount=10, VCount=10)  # -> Points, Normals, Parameters
d = Slider(0.05, range=0..0.1)
divide_curve = DivideCurve(Curve=deconstruct_brep.Edges, Count=10, Kinks=False)  # -> Points, Tangents, Parameters
trim_tree = TrimTree(Tree=divide_surface.Points, Depth=1)
center_box = CenterBox(Base=trim_tree, X=d, Y=d, Z=d)
explode_tree = ExplodeTree(Data=center_box)  # -> _0000, _0010, _0020, _0030, _0040, _0050
